vi "FrameSync.gvi"   [LabVIEW NXG 3.0.0]
inputs:
  "input signal": c128[]
  "barker code": enum{"5", "7", "11", "random"} = "random"
  "sync frame index (symbols)": i32 = 16
  "samples per symbol": f64 = 16
  "error in": error
  "Min correlation": f64
outputs:
  "output signal": c128[]
  "max index": i32
  "Training Subcodes": c128[]
  "error out": error
  "Correlation": f64[]
uses:
  NI::Analysis::Operations::1D Cross Correlation (CDB).gvi
  NI::G Core::Error::Build Error Cluster.gvi
diagram:
  To Long Integer(number=$"samples per symbol") -> w1
  Multiply($"sync frame index (symbols)", w1) -> w2
  call "BarkerCode.gvi"(barker code=$"barker code") -> (code=w3, length of one subcode=w4, subcodes=w5)
  To Double Precision Complex(number=w3) -> w6
  call "Upsampler.gvi"(Signal in=w6, Samples per symbol=$"samples per symbol", error in=$"error in") -> (Upsampled signal=w7, error out=w8)
  Array Size(array=$"input signal") -> (size(s)=w9)
  Is Greater Than 0(x=w9) -> w10
  Decrement(x=w9) -> w11
  Initialize Array(element=0, size=w11) -> w12
  # Perform cross correlation between the signal and each of the subcodes
  case (w10) {
    frame False, Default {
      w13 = w8
      w14 = f64[] []
      w15 = c128[][] []
      w16 = TRUE
    }
    frame True {
      s1 = w12  # shift register
      s2 = w8  # shift register
      for (N = w5) (iteration -> i1) {
        Array Size(array=w7) -> (size(s)=w17)
        call "Subcodemask.gvi"(input=w7, subcode length=w4, samples per symbol=$"samples per symbol", index=i1) -> (output=w18)
        # Moves the position of the subcode
        # so that the correlation indices overlap
        call "1D Cross Correlation (CDB).gvi"(x=w18, y=$"input signal", error in=s2) -> (Rxy=w19, error out=w20)
        Array Subset(array=w19, index0=w17) -> w21
        Absolute Value(x=w21) -> w22
        Add(s1, w22) -> w23
        append w21 to w15
        next s1 = w23
        next s2 = w20
      }
      w13 = s2
      w14 = s1
      w16 = FALSE
    }
  }
  Array Max And Min(array=w14) -> (max index(es)=w24, max value=w25)
  # Find index and value of max correlation
  Increment(x=w24) -> w26
  Subtract(x=w26, y=w2) -> w27
  # Shift the signal with the sync index
  Array Subset(array=$"input signal", index0=w27) -> w28
  $"output signal" <- w28
  $"max index" <- w26
  $Correlation <- w14
  # Creates array of the correlated
  # subcodes at the max correlation
  for {
    w29 = each element of w15
    Array Index(array=w29) -> (out0[w24]=w31)
    append w31 to w30
  }
  $"Training Subcodes" <- w30
  Is Less(x=w25, y=$"Min correlation") -> w32
  Logical Or(w32, w16) -> w33
  # Throws an error if the correlation is below a threshold
  case (w33) {
    frame False, Default {
      w34 = w13
    }
    frame True {
      call "Build Error Cluster.gvi"(error in=w13, code=1234567, description="Frame sync failed") -> (error out=w34)
    }
  }
  $"error out" <- w34
