vi "FreqSync.gvi"   [LabVIEW NXG 3.0.0]
inputs:
  "input": c128[]
  "Training codes": c128[]
  "Samples per symbol": f64 = 1
  "error in": error
  "barker code": enum{"5", "7", "11", "random"} = "random"
  "Frame index": i32
outputs:
  "output": c128[]
  "error out": error
  "phase drift": f64
  "intercept": f64
  "phase offset": f64
  "correction angles": f64[]
uses:
  NI::Analysis::Generation::Ramp Pattern by Samples.gvi
  NI::Analysis::Conditioning::Unwrap Phase.gvi
  NI::Analysis::Fitting::Linear Fit.gvi
  NI::Analysis::Geometry::Wrap Angle (Scalar DBL).gvi
diagram:
  call "BarkerCode.gvi"(barker code=$"barker code") -> (subcodes=w1)
  Multiply(w1, $"Samples per symbol") -> w2
  call "Ramp Pattern by Samples.gvi"(samples=w1, end=w2, exclude end=TRUE) -> (ramp pattern=w3)
  # Estimate phase offset between sub codes
  Complex To Polar(r * e^(i*theta)=$"Training codes") -> (theta=w4)
  call "Unwrap Phase.gvi"(input phase=w4, phase unit="radian in, radian out"(0), error in=$"error in") -> (unwrapped phase=w5, error out=w6)
  # Create a linear array for the x axis
  # Compensate for phase offset
  Divide(x=f64 default, y=4) -> w7
  Add(w5, w7) -> w8
  call "Linear Fit.gvi"(method="Bisquare"(2), y=w8, x=w3, error in=w6) -> (slope=w9, intercept=w10, error out=w11)
  Multiply($"Samples per symbol", $"Frame index") -> w12
  Multiply(w9, w12) -> w13
  Subtract(x=w10, y=w13) -> w14
  call "Wrap Angle (Scalar DBL).gvi"(angle=w14, wrapped angle range="-180 to 180 (-pi to pi)"(1), angle units="radian in, radian out"(0)) -> (wrapped angle=w15)
  Array Size(array=$input) -> (size(s)=w16)
  # n*phase/sub code length
  # from 0 to N
  Add(w16, 0) -> w17
  Multiply(w9, w17) -> w18
  # create phase compensation array
  call "Ramp Pattern by Samples.gvi"(samples=w17, end=w18, error in=w11) -> (ramp pattern=w19, error out=w20)
  Add(w19, w15) -> w21
  Negate(x=w21) -> w22
  Polar To Complex(r=1, theta=w22) -> (r * e^(i*theta)=w23)
  # compensate by multiplying with e^-j(n*phase/sub code length)
  Multiply($input, w23) -> w24
  $output <- w24
  # phase/subcode length
  $"phase drift" <- w9
  # remove sync frame compensation
  $"error out" <- w20
  $intercept <- w10
  $"phase offset" <- w15
