vi "ReceiverBlock2.0.gvi"   [LabVIEW NXG 3.0.0]
panel controls:
  "IQ rate": f64 = 160000
  "carrier frequency": f64 = 2450000000
  "gain (dB)": f64 = 10
  "active antenna": string = "RX2"
  "Device names": string = "USRP_06"
  "RF Channel": string = "1"
  "Symbol rate (sym/s)": i32 = 10000
  "filter length": i32 = 8
  "message length (symbols)": i32 = 88
  "sync frame index (symbols)": i32 = 44
  "Power Threshold": f64 = 1e-07
  "Frame sync": bool = TRUE
  "Freq sync": bool = TRUE
  "barker code": enum{"5", "7", "11", "random"} = "random"
  "decoding": bool
  "Interleaver": bool
  "filter parameter": f64 = 0.5
  "number of samples per USRP fetch": i64 = 20000
  "Stop_RX_2": bool
  "milliseconds to wait": u32
  "Reset BER": bool
  "Receive sound": bool
  "window length": i32
  "Extra buffer backwards": i32
  "receiver on": bool
  "y": i32
panel indicators:
  "actual IQ rate": f64
  "actual carrier frequency": f64
  "actual gain (dB)": f64
  "error out": error
  "dequeueing iteration": i32
  "IQ diagram": c128[]
  "samples/symbol": f64
  "sync frame correlation": f64[]
  "enqueueing iteration": i32
  "size(s)": i32
  "number elements in queue": i32
  "current index": i32
  "one package": f64[]
  "BER graph": f64[]
  "Mean_BER": f64
  "current BER": f64
  "Input array size": i32
  "Output array size": i32
  "Correct Size": bool
  "string": string
  "Raw input": f64[]
uses:
  NI::USRP::niUSRP Open Rx Session.gvi
  NI::USRP::niUSRP Configure Signal.gvi
  NI::USRP::niUSRP Initiate.gvi
  NI::USRP::niUSRP Fetch Rx Data (CDB).gvi
  NI::Modulation::MT Pack Bits.gvi
  NI::USRP::niUSRP Abort.gvi
  NI::USRP::niUSRP Close Session.gvi
diagram:
  w1 = $"RF Channel"
  call "niUSRP Open Rx Session.gvi"(device names=$"Device names") -> (session handle out=w2, error out=w3)
  Property Node(instance in=w2, "niUSRP"=w1, error in=w3) -> (error out=w4, instance out=w5)
  call "niUSRP Configure Signal.gvi"(active antenna=$"active antenna", session handle=w5, error in=w4, IQ rate=$"IQ rate", carrier frequency=$"carrier frequency", gain=$"gain (dB)", channel list=w1) -> (session handle out=w6, error out=w7, coerced IQ rate=w8, coerced carrier frequency=w9, coerced gain=w10)
  call "niUSRP Initiate.gvi"(session handle=w6, error in=w7) -> (session handle out=w11, error out=w12)
  Obtain Notifier(element data type=bool TRUE, error in=w12, name="error") -> (error out=w13, notifier out=w14)
  Obtain Queue(element data type=c128[] [], error in=w13) -> (error out=w15, queue out=w16)
  w17 = $"number of samples per USRP fetch"
  s1 = w15  # shift register
  s2 = w16  # shift register
  while (iteration -> i1) {
    Get Notifier Status(notifier=w14) -> (latest notification=w18)
    # Producer loop
    case (w18) {
      frame True {
        w19 = w11
        w20 = s2
        w21 = s1
      }
      frame False {
        call "niUSRP Fetch Rx Data (CDB).gvi"(session handle=w11, error in=s1, number of samples=w17, channel list=w1) -> (session handle out=w19, error out=w22, data=w23)
        Enqueue Element(element=w23, error in=w22, queue=s2) -> (error out=w21, queue out=w20)
        call "NotifyError.gvi"(notifier ref=w14, error in=w21)
      }
    }
    $"enqueueing iteration" <- i1
    next s1 = w21
    next s2 = w20
    stop if w18
  }
  Obtain Queue(element data type=u8[] [], error in=w13) -> (error out=w24, queue out=w25)
  s3 = w15  # shift register
  s4 = w16  # shift register
  s5 = uninitialised  # shift register
  s6 = c128[] []  # shift register
  while (iteration -> i2) {
    Dequeue Element(error in=s3, queue=s4) -> (element=w26, queue out=w27)
    Get Queue Status(queue=w27) -> (# elements in queue=w28)
    $"number elements in queue" <- w28
    Insert Into Array(inArray=s6, new=w26) -> w29
    Array Size(array=w29) -> (size(s)=w30)
    # Consumer loop
    w31 = $"barker code"
    w32 = $"sync frame index (symbols)"
    w33 = $"message length (symbols)"
    w34 = $"Symbol rate (sym/s)"
    call "BarkerCode.gvi"() -> (length of one subcode=w35, subcodes=w36)
    Multiply(w35, w36) -> w37
    Add(w33, w37) -> w38
    To Double Precision Float(number=w34) -> w39
    Divide(x=w8, y=w39) -> w40
    To Long Integer(number=w40) -> w41
    Multiply(w38, w41) -> w42
    Multiply(w42, 1) -> w43
    w44 = $"Extra buffer backwards"
    s7 = w44  # shift register
    s8 = s5  # shift register
    while {
      call "PacketDetector.gvi"(input=w29, index=s7, Power Threshold=$"Power Threshold", window length=$"window length") -> (detected?=w45)
      Array Size(array=w29) -> (size(s)=w46)
      Subtract(x=s7, y=w44) -> w47
      Is Greater Or Equal To 0(x=w47) -> w48
      # Add buffer
      # w49: index - buffer
      # s7: current index
      case (w48) {
        frame False, Default {
          w49 = s7
        }
        frame True {
          w49 = w47
        }
      }
      # w50: length + buffer
      # length to check
      Add(w44, w43) -> w50
      case (w45) {
        frame False, Default {
          # w44: Extra buffer backwards
          Add($"window length", s7) -> w52
          # w52: next index
          Subtract(x=w46, y=w52) -> w56
          Is Less Or Equal To 0(x=w56) -> w51
          # check if done
          case (w51) {
            frame False, Default {
              w54 = c128[] []
            }
            frame True {
              Subtract(x=w46, y=$y) -> w57
              Array Subset(array=w29, index0=w57) -> w54
            }
          }
          w53 = w15
          w55 = s8
        }
        frame True {
          Array Subset(array=w29, index0=w49, length0=w50) -> w58
          Add(s7, w50) -> w52
          Subtract(x=w46, y=w52) -> w59
          Is Less Or Equal To 0(x=w59) -> w60
          # if total frame, run receiver block
          # check if total frame
          # Stop while loop if checked whole fetch
          # w46: length of fetch
          case (w60) {
            frame False, Default {
              case ($"receiver on") {
                frame False, Default {
                  w61 = i32[] []
                  w62 = w15
                }
                frame True {
                  call "Receiver.gvi"(Interleaver=$Interleaver, Signal in=w58, filter length=$"filter length", filter parameter=$"filter parameter", IQ rate=w8, Symbol rate (sym/s)=w34, error in=w15, message length (symbols)=w33, sync frame index (symbols)=w32, barker code=w31, Frame sync=$"Frame sync", Freq sync=$"Freq sync", decoding=$decoding) -> (IQ diagram=w63, output bit stream=w61, Correlation=w64, error out=w62)
                  $"IQ diagram" <- w63
                  $"sync frame correlation" <- w64
                }
              }
              case ($"Receive sound") {
                frame True {
                  Enqueue Element(element=w61, error in=w62, queue=w25) -> (error out=w53)
                  Array Size(array=w61) -> (size(s)=w65)
                  Is Greater Than 0(x=w65) -> w66
                  case (w66) {
                    frame False, Default { }
                    frame True {
                      call "MT Pack Bits.gvi"(input bit stream=w61, bits per integer=8, packed bit order="MSB first", integer format="Unsigned") -> (output integers=w67)
                      Byte Array To String(encoding="Extended ASCII", unsigned byte array=w67) -> (string=w68)
                      $string <- w68
                    }
                  }
                  w55 = f64[] []
                }
                frame False {
                  call "Example signal.gvi"() -> (output bit stream=w69)
                  call "BER.gvi"(Output bit stream=w61, Input bit stream=w69, Array in=s8, error in=w62, Reset BER=$"Reset BER") -> (Correct Size=w70, Output array size=w71, Input array size=w72, current BER=w73, Mean_BER=w74, BER graph=w75, BER array=w55, error out=w53)
                  $"current BER" <- w73
                  $Mean_BER <- w74
                  $"BER graph" <- w75
                  $"Input array size" <- w72
                  $"Output array size" <- w71
                  $"Correct Size" <- w70
                }
              }
              Array Size(array=w58) -> (size(s)=w76)
              $"size(s)" <- w76
              Absolute Value(x=w58) -> w77
              $"one package" <- w77
              w54 = c128[] []
            }
            frame True {
              # if not total frame, append to next fetch
              Array Subset(array=w29, index0=w49) -> w54
              w53 = w15
              w55 = s8
            }
          }
          Subtract(x=w46, y=w52) -> w78
          # next index = current index + frame length +buffer
          Is Less Or Equal To 0(x=w78) -> w51
          # w52: Index + frame length + buffer
          Wait(time to wait=$"milliseconds to wait")
        }
      }
      $"current index" <- s7
      next s7 = w52
      next s8 = w55
      stop if w51
    }
    Array Size(array=w54) -> (size(s)=w79)
    Subtract(x=w30, y=w79) -> w80
    Array Subset(array=w29, length0=w80) -> w81
    Absolute Value(x=w81) -> w82
    # w54: array to next fetch
    $"Raw input" <- w82
    $"samples/symbol" <- w40
    Get Notifier Status(notifier=w14) -> (latest notification=w83, notifier out=w84)
    call "NotifyError.gvi"(notifier ref=w84, Notify anyway=$Stop_RX_2)
    $"dequeueing iteration" <- i2
    next s3 = w53
    next s4 = w27
    next s5 = s8
    next s6 = w54
    stop if w83
  }
  Release Queue(error in=s3, queue=s4) -> (error out=w85)
  call "niUSRP Abort.gvi"(session handle=w19, error in=w85) -> (session handle out=w86, error out=w87)
  call "niUSRP Close Session.gvi"(session handle=w86, error in=w87) -> (error out=w88)
  $"error out" <- w88
  $"actual IQ rate" <- w8
  $"actual carrier frequency" <- w9
  $"actual gain (dB)" <- w10
  call "Sink.gvi"(queue=w25, notifier ref=w14, error in=w24, net address_2="127.0.0.1", sink port=36363)
