vi "Sink.gvi"   [LabVIEW NXG 3.0.0]
inputs:
  "input bit stream": i8[]
  "error in": error
outputs:
  "error out": error
uses:
  sink.mli::sink matlab
diagram:
  # Check if stream is empty
  Array Size(array=$"input bit stream") -> (size(s)=w1)
  Is Greater(x=w1, y=0) -> w2
  To Word Integer(number=$"input bit stream") -> w3
  # Call matlab script
  case (w2) {
    frame False, Default {
      w4 = $"error in"
    }
    frame True {
      call "sink matlab"(data=w3, error in=$"error in") -> (error out=w4)
    }
  }
  $"error out" <- w4
