vi "Source.gvi"   [LabVIEW NXG 3.0.0]
inputs:
  "error in": error
outputs:
  "output bit stream": u8[]
  "Output": Queue<u8[]>
  "error out": error
panel controls:
  "stop": bool
uses:
  source.mli::source matlab
diagram:
  Udp Open(error in=$"error in", net address="127.0.0.1", port=26363, timeout ms=25000) -> (connection ID=w1, error out=w2)
  Obtain Queue(element data type=u8[] [], error in=w2) -> (error out=w3, queue out=w4)
  s1 = w4  # shift register
  while {
    Udp Read Binary(connection ID=w1, error in=w3, timeout ms=-1) -> (connection ID out=w5, data out=w6, error out=w7)
    Enqueue Element(element=w6, error in=w7, queue=s1) -> (error out=w8, queue out=w9)
    next s1 = w9
    stop if $stop
  }
  Udp Close(connection ID=w5, error in=w8) -> (error out=w10)
  $"error out" <- w10
  $Output <- s1
  disable {
    frame Enabled { }
    frame Disabled {
      # Call matlab script
      call "source matlab"() -> (data=w11)
      $"output bit stream" <- w11
    }
  }
