vi "Transmitter.gvi"   [LabVIEW NXG 3.0.0]
inputs:
  "input bit stream": i8[]
  "error in": error
  "IQ rate": f64
  "Barker code": enum{"5", "7", "11", "random"} = "random"
  "Barker insert index": i32
  "filter parameter": f64 = 0.5
  "filter length": i32 = 8
  "Symbol rate (sym/s)": i32
  "Frame sync": bool = TRUE
  "encode": bool
outputs:
  "signal out": c128[]
  "error out": error
  "IQ diagram": c128[]
  "total bit length": i32
panel controls:
  "code type": enum{"reed-solomon", "convolutional", "no code"} = "convolutional"
  "RS code word length (n), symbols": i32 = 7
  "RS data word length (k), symbols": i32 = 3
  "convolutional rate": enum{"1/2", "1/3", "1/4", "2/3", "3/4"} = "1/2"
  "convolutional constraint length": i32 = 3
diagram:
  Divide(x=$"IQ rate", y=$"Symbol rate (sym/s)") -> w1
  # Encoding
  case ($encode) {
    frame False, Default {
      w2 = $"input bit stream"
    }
    frame True {
      call "encode.gvi"(convolutional rate=$"convolutional rate", convolutional constraint length=$"convolutional constraint length", input bit stream=$"input bit stream", code type=$"code type", RS code word length (n), symbols=$"RS code word length (n), symbols", RS data word length (k), symbols=$"RS data word length (k), symbols") -> (data out=w2)
    }
  }
  call "BPSKMod.gvi"(input bit stream=w2, error in=$"error in") -> (Symbol out=w3, error out=w4)
  # Symbol mapping
  # Add frame sync
  case ($"Frame sync") {
    frame False, Default {
      w5 = w3
    }
    frame True {
      call "SyncFrameInserter.gvi"(Signal in=w3, insert index=$"Barker insert index", Barker code=$"Barker code") -> (Signal out=w5)
    }
  }
  # Upsample
  call "Upsampler.gvi"(Signal in=w5, Samples per symbol=w1, error in=w4) -> (Upsampled signal=w6, error out=w7)
  # Pulse shaping
  call "PulseShaping.gvi"(Signal in=w6, Samples per symbol=w1, filter parameter=$"filter parameter", filter length=$"filter length", error in=w7, tx or rx="Tx") -> (signal out=w8, error out=w9)
  $"signal out" <- w8
  $"error out" <- w9
  Array Size(array=w2) -> (size(s)=w10)
  $"total bit length" <- w10
  $"IQ diagram" <- w3
