vi "TransmitterBlock.gvi"   [LabVIEW NXG 3.0.0]
panel controls:
  "IQ rate": f64 = 160000
  "carrier frequency": f64 = 2450000000
  "Active antenna": string = "TX1"
  "stop": bool
  "Device name": string = "USRP_06"
  "gain": f64
  "RF channel": string = "0"
  "filter parameter": f64 = 0.5
  "filter length": i32 = 8
  "Symbol rate (sym/s)": i32 = 10000
  "Barker insert index": i32 = 44
  "message length (bits)": i32 = 88
  "Barker code": enum{"5", "7", "11", "random"} = "11"
  "Padding length": i32 = 111
  "encode": bool
  "Frame sync": bool = TRUE
  "Send sound": bool
  "Interleaver": bool
  "source port": u16 = 26363
  "net address_2": string = "127.0.0.1"
  "preamble?": bool = TRUE
  "Preamble code": enum{"5", "7", "11", "random"} = "random"
panel indicators:
  "actual IQ rate": f64
  "actual carrier frequency": f64
  "actual gain (dB)": f64
  "error out": error
  "Baseband Waveform (absolute value)": waveform<f64>
  "IQ diagram": c128[]
  "actual message length": i32
  "Transmitting": bool
  "number elements in queue": i32
uses:
  NI::USRP::niUSRP Open Tx Session.gvi
  NI::USRP::niUSRP Configure Signal.gvi
  NI::USRP::niUSRP Write Tx Data (CDB).gvi
  NI::G Core::Error::Filter Error Code.gvi
  NI::USRP::niUSRP Close Session.gvi
  NI::G Core::Error::Multiplex Errors.gvi
diagram:
  w1 = $"RF channel"
  call "niUSRP Open Tx Session.gvi"(device names=$"Device name") -> (session handle out=w2, error out=w3)
  Property Node(instance in=w2, "niUSRP"=w1, error in=w3) -> (error out=w4, instance out=w5)
  call "niUSRP Configure Signal.gvi"(active antenna=$"Active antenna", session handle=w5, error in=w4, IQ rate=$"IQ rate", carrier frequency=$"carrier frequency", gain=$gain, channel list=w1) -> (session handle out=w6, error out=w7, coerced IQ rate=w8, coerced carrier frequency=w9, coerced gain=w10)
  Obtain Notifier(element data type=bool TRUE, error in=w7, name="error") -> (error out=w11, notifier out=w12)
  Obtain Queue(element data type=u8[] []) -> (queue out=w13)
  call "Source.gvi"(queue=w13, notifier ref=w12, error in=w11, net address=$"net address_2", source port=$"source port") -> (error out=w14)
  while {
    Get Notifier Status(notifier=w12) -> (latest notification=w15)
    case (w15) {
      frame True {
        w16 = w7
        w17 = w6
      }
      frame False {
        case ($"Send sound") {
          frame False, Default {
            call "Example signal.gvi"(message length (bits)=$"message length (bits)") -> (output bit stream=w18)
            w19 = w7
          }
          frame True {
            Get Queue Status(queue=w13) -> (# elements in queue=w20)
            $"number elements in queue" <- w20
            Dequeue Element(queue=w13, timeout in ms=100) -> (element=w18)
            w19 = w7
          }
        }
        Array Size(array=w18) -> (size(s)=w21)
        Subtract(x=w21, y=$"message length (bits)") -> w22
        call "ZeroPaddingInt.gvi"(Input=w18, Padding length=w22, samples per symbol=1, pad beginning=FALSE, pad end=TRUE) -> (output array=w23)
        Is Greater(x=w21, y=0) -> w24
        case (w24) {
          frame False, Default {
            w25 = $stop
            w16 = w19
            w17 = w6
          }
          frame True {
            call "Transmitter.gvi"(filter parameter=$"filter parameter", filter length=$"filter length", Interleaver=$Interleaver, input bit stream=w23, IQ rate=w8, Symbol rate (sym/s)=$"Symbol rate (sym/s)", Frame sync=$"Frame sync", error in=w19, Barker code=$"Barker code", Barker insert index=$"Barker insert index", encode=$encode, preamble?=$"preamble?", Preamble code=$"Preamble code") -> (signal out=w26, IQ diagram=w27, error out=w28)
            Divide(x=w8, y=$"Symbol rate (sym/s)") -> w29
            call "ZeroPaddingDbl.gvi"(Input=w26, Padding length=$"Padding length", samples per symbol=w29) -> (output array=w30)
            call "niUSRP Write Tx Data (CDB).gvi"(session handle=w6, error in=w28, data=w30, end of data?=$stop, channel list=w1) -> (session handle out=w17, error out=w31)
            # ignore underflow
            call "Filter Error Code.gvi"(error in=w31, code to clear=-1074118645) -> (error out=w16)
            $"IQ diagram" <- w27
            Absolute Value(x=w30) -> w32
            Reciprocal(x=$"Symbol rate (sym/s)") -> w33
            Build Waveform Node(Y=w32, dt=w33) -> (output waveform=w34)
            $"Baseband Waveform (absolute value)" <- w34
            w25 = $stop
          }
        }
        call "NotifyError.gvi"(notifier ref=w12, Notify anyway=w25, error in=w16)
        $"actual message length" <- w21
        $Transmitting <- w24
      }
    }
    stop if w15
  }
  call "niUSRP Close Session.gvi"(session handle=w17, error in=w16) -> (error out=w35)
  call "Multiplex Errors.gvi"(error in 1=w14, error in 2=w35) -> (error out=w36)
  Release Notifier(error in (no error)=w36, notifier=w12) -> (error out=w37)
  $"error out" <- w37
  $"actual IQ rate" <- w8
  $"actual carrier frequency" <- w9
  $"actual gain (dB)" <- w10
